# Grasshopper definition render_mode_view2.gh (Grasshopper 1.0.8)
# plug-ins: RhinoCodePluginGH, Kangaroo Components, EleFront, Bifocals, eleFront

# ---- group: target_1
box = Box({Plane=PlaneXY(1903.999991, 3299.926423, 1360), X=Domain(0, 16192.27485), Y=Domain(0, 15200.15552), Z=Domain(0, 3969.171021)})
bounding_box = BoundingBox(Content=box, Plane=PlaneXY(0, 0, 0))  # -> Box, Box_2
box_properties = BoxProperties(Box=bounding_box.Box)  # -> Center, Diagonal, Area, Volume, Degeneracy
unit_z = UnitZ(Factor=Slider(1000, range=0..10000))
transform = Transform(Geometry=box_properties.Center, Transform=unit_z)
panel = Panel(box_properties.Center)
unit_x = UnitX(Factor="-900")
transform_2 = Transform(Geometry=transform, Transform=unit_x)
unit_y = UnitY(Factor="1300")
transform_3 = Transform(Geometry=transform_2, Transform=unit_y)

# ----
box_2 = Box({Plane=Plane(origin=(0, 20000, 50), x=(1, 0, 0), y=(0, -1, 0)), X=Domain(0, 20000), Y=Domain(0, 20000), Z=Domain(-5290, 0)})

# ---- group: target_2
box_3 = Box({Plane=PlaneXY(1903.999991, 3299.926423, 1360), X=Domain(0, 16192.27485), Y=Domain(0, 15200.15552), Z=Domain(0, 3969.171021)})
bounding_box_2 = BoundingBox(Content=box_3, Plane=PlaneXY(0, 0, 0))  # -> Box, Box_2
box_properties_2 = BoxProperties(Box=bounding_box_2.Box)  # -> Center, Diagonal, Area, Volume, Degeneracy
number_slider = Slider(1470, range=0..10000)
unit_z_2 = UnitZ(Factor="-4550")
transform_4 = Transform(Geometry=box_properties_2.Center, Transform=unit_z_2)
panel_2 = Panel(box_properties_2.Center)
unit_x_2 = UnitX(Factor="3000")
transform_5 = Transform(Geometry=transform_4, Transform=unit_x_2)
unit_y_2 = UnitY(Factor="-2900")
transform_6 = Transform(Geometry=transform_5, Transform=unit_y_2)
panel_3 = Panel(transform_6)
point = Point(transform_6)

# ---- group: camera_2
construct_point = ConstructPoint(XCoordinate="-3000.000", YCoordinate="27000.000", ZCoordinate="1500.000")  # -> graft(Point)
point_2 = Point(construct_point)

# ---- group: camera_1
construct_point_2 = ConstructPoint(XCoordinate="33634.000", YCoordinate="-16785.624", ZCoordinate="7357.789")  # -> graft(Point)
point_3 = Point(construct_point_2)

# ----
unit_z_3 = UnitZ(Factor=Slider(7500, range=0..10000))
point_4 = Point(<point referenced from the Rhino model>)
transform_7 = Transform(Geometry=point_4, Transform=unit_z_3)

trigger = Trigger(Interval=1000, TimerInterval=1000, Target=counter)  # disabled
panel_4 = Panel("1070")
counter = Counter(Reset=Toggle(False))
expression = Expression(x=counter, Expression="(x/9)%7")
expression_2 = Expression(x=counter, Expression="x/9")
expression_3 = Expression(x=counter, Expression="x%9")
panel_5 = Panel(expression_2)
cam_index = Integer(expression_3)
mode_index = Integer(expression)
round = Round(Number=expression_2)  # -> Nearest, Floor, Ceiling
panel_6 = Panel(mode_index)
panel_7 = Panel(cam_index)
panel_8 = Panel(round.Floor)
step_index = Integer(round.Floor)
panel_9 = Panel("""Wireframe
Shaded
Technical
Artistic
Pen
Monochrome
Arctic""")
list_item = ListItem(List=panel_9, Index=mode_index, Wrap=True)
panel_10 = Panel(list_item)

panel_11 = Panel("DQZ_B")
panel_12 = Panel("DQZ_A")
merge = Merge(Data1="Shell_A1", Data2="Shell_A2", Data3="Shell_B1", Data4="Shell_B2", Data5="Shell_C1", Data6="Shell_C2")
reference_block_by_name = ReferenceBlockByName(BlockName=merge, getNestedBlocks=False, lightweight=False)
geometry = Geometry(reference_block_by_name)
get_user_value = GetUserValue(Geometry=geometry, Key="8_工序编号")  # -> flatten(_8_工序编号)
panel_13 = Panel(get_user_value)
get_user_value_2 = GetUserValue(Geometry=geometry, Key="0_构件ID")  # -> flatten(_0_构件ID)
filter_by_user_attributes = FilterByUserAttributes(Key="8_工序编号", Val=step_index, Attributes=flatten(geometry), invertFilter=False)
smaller_than = SmallerThan(FirstNumber=panel_13, SecondNumber=step_index)  # -> SmallerThan, OrEqualTo
dispatch = Dispatch(List=get_user_value_2, DispatchPattern=smaller_than.OrEqualTo)  # -> ListA, ListB
geometry_2 = Geometry(filter_by_user_attributes)
panel_14 = Panel(geometry_2)
explode_block = ExplodeBlock(Block=geometry_2, recursive=False)  # -> Name, Transform, flatten(Geometry)
get_user_value_3 = GetUserValue(Geometry=geometry_2, Key="0_构件ID")
panel_15 = Panel(dispatch.ListA)
dispatch_2 = Dispatch(List=flatten(geometry), DispatchPattern=smaller_than.OrEqualTo)  # -> ListA, ListB
panel_16 = Panel(get_user_value_3)
brep = Brep(explode_block.Geometry)
bounding_box_3 = BoundingBox(Content=brep, Plane=PlaneXY(0, 0, 0))  # -> Box, Box_2
geometry_3 = Geometry(dispatch_2.ListB)
geometry_4 = Geometry(dispatch_2.ListA)
volume = Volume(Geometry=bounding_box_3.Box)  # -> Volume, Centroid
custom_preview = CustomPreview(Geometry=geometry_4, Material=ColourSwatch(SwatchColor=RGB(246, 212, 71)))
point_5 = Point(volume.Centroid)
panel_17 = Panel(point_5)

camera_origin = Point(point_2)

# ---- group: 随机添加障碍物
panel_18 = Panel("worker_2")
panel_19 = Panel("worker_1")
reference_block_by_name_2 = ReferenceBlockByName(getNestedBlocks=False, lightweight=False)
reference_block_by_name_3 = ReferenceBlockByName(getNestedBlocks=False, lightweight=False)
geometry_5 = Geometry(reference_block_by_name_2)
geometry_6 = Geometry(reference_block_by_name_3)
merge_2 = Merge(Data1=geometry_5, Data2=geometry_6)
explode_block_2 = ExplodeBlock(Block=geometry_5, recursive=False)  # -> Name, Transform, Geometry
explode_block_3 = ExplodeBlock(Block=geometry_6, recursive=False)  # -> Name, Transform, Geometry
mesh = Mesh(explode_block_2.Geometry)
mesh_2 = Mesh(explode_block_3.Geometry)
bounding_box_4 = BoundingBox(Content=mesh, Plane=PlaneXY(0, 0, 0))  # -> Box, Box_2
bounding_box_5 = BoundingBox(Content=mesh_2, Plane=PlaneXY(0, 0, 0))  # -> Box, Box_2
panel_20 = Panel(bounding_box_4.Box)
list_item_2 = ListItem(List=bounding_box_4.Box, Index=Slider(3, range=0..10), Wrap=True)
box_4 = Box()
list_item_3 = ListItem(List=bounding_box_5.Box, Index=Slider(7, range=0..10), Wrap=True)
box_5 = Box(list_item_2)
box_corners = BoxCorners(Box=box_4)  # -> CornerA, CornerB, CornerC, CornerD, CornerE, CornerF, CornerG, CornerH
box_6 = Box(list_item_3)
merge_3 = Merge(Data1=box_5, Data2=box_6)
merge_4 = Merge(Data1=box_corners.CornerA, Data2=box_corners.CornerB, Data3=box_corners.CornerC, Data4=box_corners.CornerD)
volume_2 = Volume(Geometry=merge_3)  # -> Volume, Centroid
point_6 = Point(merge_4)
point_7 = Point(volume_2.Centroid)
unit_z_4 = UnitZ(Factor="-890")
random_reduce = RandomReduce(List=point_6, Reduction=Slider(2, range=0..10), Seed=Slider(9, range=0..20))
move = Move(Geometry=point_7, Motion=unit_z_4)  # -> Geometry, Transform
point_8 = Point(random_reduce)
point_9 = Point(move.Geometry)
panel_21 = Panel(point_8)
vector_2pt = Vector2Pt(PointA=point_9, PointB=point_8, Unitize=False)  # -> Vector, Length
panel_22 = Panel(point_9)
move_2 = Move(Geometry=merge_2, Motion=vector_2pt.Vector)  # -> Geometry, Transform

# ----
摄像头坐标点 = Panel(camera_origin)
model_center = Point(point)
vector_2pt_2 = Vector2Pt(PointA=camera_origin, PointB=model_center, Unitize=Toggle(False))  # -> Vector, Length
vector_display = VectorDisplay(Anchor=camera_origin, Vector=vector_2pt_2.Vector)
panel_23 = Panel(vector_2pt_2.Length)
expression_4 = Expression(x=panel_23, y="3", Expression="x*y*π/180")
panel_24 = Panel(expression_4)
unit_z_5 = UnitZ(Factor=panel_24)
transform_8 = Transform(Geometry=model_center, Transform=unit_z_5)
panel_25 = Panel("""45
90
135
180
225
270
315
360""")

expression_5 = Expression(x=panel_23, y="6", Expression="x*y*π/180")
panel_26 = Panel(expression_5)
unit_z_6 = UnitZ(Factor=panel_26)
transform_9 = Transform(Geometry=model_center, Transform=unit_z_6)
point_10 = Point(transform_9)
rotate_3d = Rotate3D(Geometry=point_10, Angle=degrees(panel_25), Center=model_center, Axis=vector_2pt_2.Vector)  # -> Geometry, Transform

point_11 = Point(transform_8)
rotate_3d_2 = Rotate3D(Geometry=point_11, Angle=degrees(panel_25), Center=model_center, Axis=vector_2pt_2.Vector)  # -> Geometry, Transform
merge_5 = Merge(Data1=model_center, Data2=rotate_3d_2.Geometry)
list_item_4 = ListItem(List=merge_5, Index=cam_index, Wrap=True)
panel_27 = Panel(list_item_4)
point_12 = Point(list_item_4)
integer = Integer(Slider(2, range=0..10))
python_3_script = Python3Script(
    center_points=point_5,
    geometries=brep,
    ids=get_user_value_3,
    step_index=step_index,
    camera_pt=camera_origin,
    cam_index=integer,
    target_pt=list_item_4,
    cam_index_2=cam_index,
    image_path="C:\Users\10205\theco\Monochrome",
    run=Toggle(True),
    total_steps="17")  # -> out, a; inputs center_points: list of Point3d, geometries: list of Brep, ids: list, step_index: Int32, camera_pt: Point3d, cam_index: Int32, target_pt: Point3d
# ---------- python_3_script: Python ----------
"""Grasshopper Script"""

import rhinoscriptsyntax as rs
import scriptcontext as sc
import Rhino
import System
import os
import json
import time
from Rhino.Geometry import Point3d
from System.Drawing import Bitmap, Graphics, Imaging, Size

# ========== 切换到 Rhino 文档 ==========
ghdoc = sc.doc
sc.doc = Rhino.RhinoDoc.ActiveDoc

# ========== 参数检查 ==========
if not isinstance(camera_pt, Point3d):
    raise TypeError(f"❌ camera_pt 类型错误: {type(camera_pt)}，应为 Point3d")
if not isinstance(target_pt, Point3d):
    raise TypeError(f"❌ target_pt 类型错误: {type(target_pt)}，应为 Point3d")

# ========== 图像导出尺寸 ==========
img_width = 1280
img_height = 720

# ========== 路径准备 ==========
step_folder = os.path.join(image_path, f"step_{step_index}")
if not os.path.exists(step_folder):
    os.makedirs(step_folder)

filename = f"Monochrome_frame_{cam_index+1:02d}.jpg"   #render
full_img_path = os.path.join(step_folder, filename)

json_path = os.path.join(step_folder, f"bbox_step_{step_index}.json")
csv_path = os.path.join(step_folder, f"component_centers_step_{step_index}.csv")

# ========== 设置图层并清理 ==========
layer_name = f"Step_{step_index}"
if not rs.IsLayer(layer_name):
    rs.AddLayer(layer_name)
rs.CurrentLayer(layer_name)

objs = rs.ObjectsByLayer(layer_name)
if objs:
    rs.DeleteObjects(objs)

# ========== Bake 几何体 ==========
baked_ids = []
real_geometries = []

for geo, gid in zip(geometries, ids):
    brep = rs.coercegeometry(geo)
    if isinstance(brep, Rhino.Geometry.Brep):
        attr = Rhino.DocObjects.ObjectAttributes()
        attr.LayerIndex = sc.doc.Layers.FindByFullPath(layer_name, -1)
        obj_id = sc.doc.Objects.AddBrep(brep, attr)
        baked_ids.append(obj_id)
        real_geometries.append(brep)
    else:
        print(f"⚠️ 构件 {gid} 无法转换为 Brep")

sc.doc.Views.Redraw()

# ========== 设置视图 ==========
view = sc.doc.Views.ActiveView
vp = view.ActiveViewport
vp.SetCameraLocation(camera_pt, True)
vp.SetCameraTarget(target_pt, True)
vp.Camera35mmLensLength = 18.0

# 强制设置视图窗口大小为 1280x720
sc.doc.Views.ActiveView.Size = System.Drawing.Size(img_width, img_height)

mode = Rhino.Display.DisplayModeDescription.FindByName("Monochrome")  #Rendered
if mode:
    vp.DisplayMode = mode

view.Redraw()
time.sleep(0.5)

# ========== 导出图像为 24-bit 96dpi（用于 YOLO） ==========
bmp = view.CaptureToBitmap(System.Drawing.Size(img_width, img_height))
if bmp:
    # 设置分辨率
    bmp.SetResolution(96, 96)

    # 检查是否为 32 位图像（带 Alpha）
    if bmp.PixelFormat == System.Drawing.Imaging.PixelFormat.Format32bppArgb:
        # 创建新的 24 位图像（RGB）
        rgb_bmp = System.Drawing.Bitmap(bmp.Width, bmp.Height, System.Drawing.Imaging.PixelFormat.Format24bppRgb)
        rgb_bmp.SetResolution(96, 96)

        # 在新图上绘制旧图（自动丢弃 Alpha）
        g = System.Drawing.Graphics.FromImage(rgb_bmp)
        g.DrawImage(bmp, 0, 0)
        g.Dispose()

        # 保存 24-bit 图像
        rgb_bmp.Save(full_img_path, System.Drawing.Imaging.ImageFormat.Png)
        rgb_bmp.Dispose()
    else:
        # 如果原图已是 RGB，则直接保存
        bmp.Save(full_img_path, System.Drawing.Imaging.ImageFormat.Png)

    bmp.Dispose()
    print(f"📸 Saved as 24-bit RGB: {full_img_path}")


# ========== 导出标签 ==========
view_width = img_width
view_height = img_height

projected_components = []
csv_lines = []

for obj_id, gid, pt in zip(baked_ids, ids, center_points):
    obj = sc.doc.Objects.Find(obj_id)
    if not obj:
        continue
    try:
        bbox = obj.Geometry.GetBoundingBox(True)
        corners = bbox.GetCorners()
        screen_pts = [vp.WorldToClient(cpt) for cpt in corners]

        # 注意：使用真实图片尺寸进行像素投影
        xs = [pt.X * (img_width / view_width) for pt in screen_pts]
        ys = [pt.Y * (img_height / view_height) for pt in screen_pts]

        x_min = min(xs)
        x_max = max(xs)
        y_min = min(ys)
        y_max = max(ys)

        # 限制边界在图像范围内
        x_min = min(max(x_min, 0), img_width - 1)
        x_max = min(max(x_max, 0), img_width - 1)
        y_min = min(max(y_min, 0), img_height - 1)
        y_max = min(max(y_max, 0), img_height - 1)

        screen_center = vp.WorldToClient(pt)
        x_pixel = screen_center.X * (img_width / view_width)
        y_pixel = screen_center.Y * (img_height / view_height)

        x_norm = x_pixel / img_width
        y_norm = y_pixel / img_height

        projected_components.append({
            "id": gid,
            "world": [pt.X, pt.Y, pt.Z],
            "pixel": [x_pixel, y_pixel],
            "normalized": [round(x_norm, 6), round(y_norm, 6)],
            "bbox_2d": [x_min, y_min, x_max, y_max]
        })

        csv_lines.append(f"{gid},{pt.X:.3f},{pt.Y:.3f},{pt.Z:.3f}")

    except Exception as e:
        print(f"⚠️ 投影失败 {gid}: {e}")

# ========== 写入 JSON（追加） ==========
meta = {
    "filename": filename,
    "step": step_index,
    "camera_index": cam_index,
    "camera_origin": [camera_pt.X, camera_pt.Y, camera_pt.Z],
    "target_point": [target_pt.X, target_pt.Y, target_pt.Z],
    "display_mode": "Monochrome",  #Rendered
    "total_steps": total_steps,
    "components": projected_components
}

if os.path.exists(json_path):
    with open(json_path, "r") as f:
        json_data = json.load(f)
else:
    json_data = []

json_data.append(meta)

with open(json_path, "w") as f:
    json.dump(json_data, f, indent=2)
    print(f"📄 JSON written: {json_path}")

# ========== 写入 CSV（首次写） ==========
if not os.path.exists(csv_path):
    with open(csv_path, "w") as f:
        for line in csv_lines:
            f.write(line + "\n")
    print(f"📅 CSV written: {csv_path}")

# ========== 恢复 GH 文档 ==========
sc.doc = ghdoc
a = "Done"
# ---------- end python_3_script ----------
panel_28 = Panel(python_3_script.out)

# ---- group: 640x640 未设置强制尺寸
python_3_script_2 = Python3Script()  # -> out, a; inputs center_points: list of Point3d, geometries: list of Brep, ids: list, step_index: Int32, camera_pt: Point3d, cam_index: Int32, target_pt: Point3d
# ---------- python_3_script_2: Python ----------
"""Grasshopper Script"""
import rhinoscriptsyntax as rs
import scriptcontext as sc
import Rhino
import System
import os
import json
import time
from Rhino.Geometry import Point3d

# ========== 切换到 Rhino 文档 ==========
ghdoc = sc.doc
sc.doc = Rhino.RhinoDoc.ActiveDoc

# ========== 参数检查 ==========
if not isinstance(camera_pt, Point3d):
    raise TypeError(f"❌ camera_pt 类型错误: {type(camera_pt)}，应为 Point3d")
if not isinstance(target_pt, Point3d):
    raise TypeError(f"❌ target_pt 类型错误: {type(target_pt)}，应为 Point3d")

# ========== 路径准备 ==========
step_folder = os.path.join(image_path, f"step_{step_index}")
if not os.path.exists(step_folder):
    os.makedirs(step_folder)

filename = f"render_frame_{cam_index+1:02d}.png"
full_img_path = os.path.join(step_folder, filename)

json_path = os.path.join(step_folder, f"bbox_step_{step_index}.json")
csv_path = os.path.join(step_folder, f"component_centers_step_{step_index}.csv")

# ========== 设置图层并清理 ==========
layer_name = f"Step_{step_index}"
if not rs.IsLayer(layer_name):
    rs.AddLayer(layer_name)
rs.CurrentLayer(layer_name)

objs = rs.ObjectsByLayer(layer_name)
if objs:
    rs.DeleteObjects(objs)

# ========== Bake 几何体 ==========
baked_ids = []
real_geometries = []

for geo, gid in zip(geometries, ids):
    brep = rs.coercegeometry(geo)
    if isinstance(brep, Rhino.Geometry.Brep):
        attr = Rhino.DocObjects.ObjectAttributes()
        attr.LayerIndex = sc.doc.Layers.FindByFullPath(layer_name, -1)
        obj_id = sc.doc.Objects.AddBrep(brep, attr)
        baked_ids.append(obj_id)
        real_geometries.append(brep)
    else:
        print(f"⚠️ 构件 {gid} 无法转换为 Brep")

sc.doc.Views.Redraw()

# ========== 设置视图 ==========
view = sc.doc.Views.ActiveView
vp = view.ActiveViewport
vp.SetCameraLocation(camera_pt, True)
vp.SetCameraTarget(target_pt, True)
vp.Camera35mmLensLength = 30.0

mode = Rhino.Display.DisplayModeDescription.FindByName("Rendered")
if mode:
    vp.DisplayMode = mode

view.Redraw()
time.sleep(0.5)

# ========== 导出图像 ==========
bmp = view.CaptureToBitmap(System.Drawing.Size(640, 640))
if bmp:
    bmp.Save(full_img_path)
    print(f"📸 Saved: {full_img_path}")

# ========== 导出标签 ==========
view_width = view.ClientRectangle.Width
view_height = view.ClientRectangle.Height

projected_components = []
csv_lines = []

for obj_id, gid, pt in zip(baked_ids, ids, center_points):
    obj = sc.doc.Objects.Find(obj_id)
    if not obj:
        continue
    try:
        bbox = obj.Geometry.GetBoundingBox(True)
        corners = bbox.GetCorners()
        screen_pts = [vp.WorldToClient(cpt) for cpt in corners]
        xs = [pt.X * (640 / view_width) for pt in screen_pts]
        ys = [pt.Y * (640 / view_height) for pt in screen_pts]

        x_min = min(xs)
        x_max = max(xs)
        y_min = min(ys)
        y_max = max(ys)

        x_min = min(max(x_min, 0), 639)
        y_min = min(max(y_min, 0), 639)
        x_max = min(max(x_max, 0), 639)
        y_max = min(max(y_max, 0), 639)

        screen_center = vp.WorldToClient(pt)
        x_pixel = screen_center.X * (640 / view_width)
        y_pixel = screen_center.Y * (640 / view_height)

        x_norm = x_pixel / 640.0
        y_norm = y_pixel / 640.0

        projected_components.append({
            "id": gid,
            "world": [pt.X, pt.Y, pt.Z],
            "pixel": [x_pixel, y_pixel],
            "normalized": [round(x_norm, 6), round(y_norm, 6)],
            "bbox_2d": [x_min, y_min, x_max, y_max]
        })

        csv_lines.append(f"{gid},{pt.X:.3f},{pt.Y:.3f},{pt.Z:.3f}")

    except Exception as e:
        print(f"⚠️ 投影失败 {gid}: {e}")

# ========== 写入 JSON（追加） ==========
meta = {
    "filename": filename,
    "step": step_index,
    "camera_index": cam_index,
    "camera_origin": [camera_pt.X, camera_pt.Y, camera_pt.Z],
    "target_point": [target_pt.X, target_pt.Y, target_pt.Z],
    "display_mode": "Rendered",
    "total_steps": total_steps,
    "components": projected_components
}

if os.path.exists(json_path):
    with open(json_path, "r") as f:
        json_data = json.load(f)
else:
    json_data = []

json_data.append(meta)

with open(json_path, "w") as f:
    json.dump(json_data, f, indent=2)
    print(f"📄 JSON written: {json_path}")

# ========== 写入 CSV（首次写） ==========
if not os.path.exists(csv_path):
    with open(csv_path, "w") as f:
        for line in csv_lines:
            f.write(line + "\n")
    print(f"📅 CSV written: {csv_path}")

# ========== 恢复 GH 文档 ==========
sc.doc = ghdoc
a = "Done"
# ---------- end python_3_script_2 ----------
