# Grasshopper definition render_model_final.gh (Grasshopper 1.0.8)
# plug-ins: RhinoCodePluginGH, Kangaroo Components, EleFront, eleFront

# ---- group: target_1
construct_point = ConstructPoint(XCoordinate="7000.000", YCoordinate="9500", ZCoordinate="6500.000")  # -> graft(Point)
point = Point(construct_point)

# ---- group: target_2
construct_point_2 = ConstructPoint(XCoordinate="13000.000", YCoordinate="8000.000", ZCoordinate="-1205.000")  # -> graft(Point)
point_2 = Point(construct_point_2)

# ----
panel = Panel("焦距18mm")

# ---- group: camera_2
construct_point_3 = ConstructPoint(XCoordinate="-3000.000", YCoordinate="27000.000", ZCoordinate="1500.000")  # -> graft(Point)
point_3 = Point(construct_point_3)

# ---- group: camera_1
construct_point_4 = ConstructPoint(XCoordinate="35500.000", YCoordinate="-16000.000", ZCoordinate="8000.000")  # -> graft(Point)
point_4 = Point(construct_point_4)

# ----
unit_z = UnitZ(Factor="4841")
point_5 = Point(<point referenced from the Rhino model>)
unit_z_2 = UnitZ(Factor="-1659.966594")
transform = Transform(Geometry=point_5, Transform=unit_z)
deconstruct = Deconstruct(Point=point_5)  # -> XComponent, YComponent, ZComponent
transform_2 = Transform(Geometry=point_5, Transform=unit_z_2)
line = Line(StartPoint=point_4, EndPoint=transform)
panel_2 = Panel(transform)
line_2 = Line(StartPoint=point_3, EndPoint=transform)
panel_3 = Panel(transform_2)
length = Length(Curve=line)
length_2 = Length(Curve=line_2)
panel_4 = Panel(length)
panel_5 = Panel(length_2)

panel_6 = Panel("焦距25mm")
relay = Relay()

# ---- group: Image output setting
trigger = Trigger(Interval=500, TimerInterval=500, Target=counter)  # disabled
counter = Counter(Reset=Toggle(False))
expression = Expression(x=counter, Expression="x/13")
expression_2 = Expression(x=counter, Expression="(x/9)%7")
expression_3 = Expression(x=counter, Expression="x%13")
panel_7 = Panel(expression)
mode_index = Integer(expression_2)
cam_index = Integer(expression_3)
round = Round(Number=expression)  # -> Nearest, Floor, Ceiling
panel_8 = Panel(mode_index)
panel_9 = Panel(cam_index)
panel_10 = Panel("""Wireframe
Shaded
Technical
Artistic
Pen
Monochrome
Arctic""")
step_index = Integer(round.Floor)
panel_11 = Panel(step_index)
list_item = ListItem(List=panel_10, Index=mode_index, Wrap=True)
panel_12 = Panel(list_item)

# ---- group: Activities design
panel_13 = Panel("DQZ_B")
panel_14 = Panel("DQZ_A")
merge = Merge(Data1="Shell_A1", Data2="Shell_A2", Data3="Shell_B1", Data4="Shell_B2", Data5="Shell_C1", Data6="Shell_C2")
reference_block_by_name = ReferenceBlockByName(BlockName=merge, getNestedBlocks=False, lightweight=False)
geometry = Geometry(reference_block_by_name)
get_user_value = GetUserValue(Geometry=geometry, Key="8_工序编号")  # -> flatten(_8_工序编号)
get_user_value_2 = GetUserValue(Geometry=geometry, Key="0_构件ID")  # -> flatten(_0_构件ID)
panel_15 = Panel(get_user_value)
filter_by_user_attributes = FilterByUserAttributes(Key="8_工序编号", Val=step_index, Attributes=flatten(geometry), invertFilter=False)
geometry_2 = Geometry(filter_by_user_attributes)
panel_16 = Panel(geometry_2)
smaller_than = SmallerThan(FirstNumber=panel_15, SecondNumber=step_index)  # -> SmallerThan, OrEqualTo
dispatch = Dispatch(List=get_user_value_2, DispatchPattern=smaller_than.OrEqualTo)  # -> ListA, ListB
explode_block = ExplodeBlock(Block=geometry_2, recursive=False)  # -> Name, Transform, flatten(Geometry)
get_user_value_3 = GetUserValue(Geometry=geometry_2, Key="0_构件ID")
panel_17 = Panel(dispatch.ListA)
dispatch_2 = Dispatch(List=flatten(geometry), DispatchPattern=smaller_than.OrEqualTo)  # -> ListA, ListB
brep = Brep(explode_block.Geometry)
panel_18 = Panel(get_user_value_3)
bounding_box = BoundingBox(Content=brep, Plane=PlaneXY(0, 0, 0))  # -> Box, Box_2
geometry_3 = Geometry(dispatch_2.ListA)
geometry_4 = Geometry(dispatch_2.ListB)
volume = Volume(Geometry=bounding_box.Box)  # -> Volume, Centroid
custom_preview = CustomPreview(Geometry=geometry_3, Material=ColourSwatch(SwatchColor=RGB(246, 212, 71)))
point_6 = Point(volume.Centroid)

# ----
camera_origin = Point(point_3)

model_center = Point(point_2)
vector_2pt = Vector2Pt(PointA=camera_origin, PointB=model_center, Unitize=Toggle(False))  # -> Vector, Length
panel_19 = Panel(vector_2pt.Length)
vector_display = VectorDisplay(Anchor=camera_origin, Vector=vector_2pt.Vector)
expression_4 = Expression(x=panel_19, y="3", Expression="x*y*π/180")
panel_20 = Panel(expression_4)
panel_21 = Panel("""30
60
90
120
150
180
210
240
270
300
330
360""")
unit_z_3 = UnitZ(Factor=panel_20)
transform_3 = Transform(Geometry=model_center, Transform=unit_z_3)
point_7 = Point(transform_3)
rotate_3d = Rotate3D(Geometry=point_7, Angle=degrees(panel_21), Center=model_center, Axis=vector_2pt.Vector)  # -> Geometry, Transform
merge_2 = Merge(Data1=model_center, Data2=rotate_3d.Geometry)
list_item_2 = ListItem(List=merge_2, Index=cam_index, Wrap=True)

摄像头坐标点 = Panel(camera_origin)
expression_5 = Expression(x=expression, Expression="x+15")

# ---- group: Images output
integer = Integer(Slider(2, range=0..10))
python_3_script = Python3Script(
    center_points=point_6,
    geometries=brep,
    ids=get_user_value_3,
    step_index=step_index,
    camera_pt=camera_origin,
    cam_index=integer,
    target_pt=list_item_2,
    cam_index_2=cam_index,
    image_path="C:\Users\10205\theco\View_2\Rendered_1",
    run=Toggle(False),
    total_steps="18")  # -> out, a; inputs center_points: list of Point3d, geometries: list of Brep, ids: list, step_index: Int32, camera_pt: Point3d, cam_index: Int32, target_pt: Point3d
# ---------- python_3_script: Python ----------
"""Grasshopper Script"""

import rhinoscriptsyntax as rs
import scriptcontext as sc
import Rhino
import System
import os
import json
import time
from Rhino.Geometry import Point3d
from System.Drawing import Bitmap, Graphics, Imaging, Size

# ========== 切换到 Rhino 文档 ==========
ghdoc = sc.doc
sc.doc = Rhino.RhinoDoc.ActiveDoc

# ========== 参数检查 ==========
if not isinstance(camera_pt, Point3d):
    raise TypeError(f"❌ camera_pt 类型错误: {type(camera_pt)}，应为 Point3d")
if not isinstance(target_pt, Point3d):
    raise TypeError(f"❌ target_pt 类型错误: {type(target_pt)}，应为 Point3d")

# ========== 图像导出尺寸 ==========
img_width = 1280
img_height = 720

# ========== 路径准备 ==========
step_folder = os.path.join(image_path, f"step_{step_index}")
if not os.path.exists(step_folder):
    os.makedirs(step_folder)

filename = f"Rendered_1_frame_{cam_index+1:02d}.jpg"   #Rendered
full_img_path = os.path.join(step_folder, filename)

json_path = os.path.join(step_folder, f"bbox_step_{step_index}.json")
csv_path = os.path.join(step_folder, f"component_centers_step_{step_index}.csv")

# ========== 设置图层并清理 ==========
layer_name = f"Step_{step_index}"
if not rs.IsLayer(layer_name):
    rs.AddLayer(layer_name)
rs.CurrentLayer(layer_name)

objs = rs.ObjectsByLayer(layer_name)
if objs:
    rs.DeleteObjects(objs)

# ========== Bake 几何体 ==========
baked_ids = []
real_geometries = []

for geo, gid in zip(geometries, ids):
    brep = rs.coercegeometry(geo)
    if isinstance(brep, Rhino.Geometry.Brep):
        attr = Rhino.DocObjects.ObjectAttributes()
        attr.LayerIndex = sc.doc.Layers.FindByFullPath(layer_name, -1)
        obj_id = sc.doc.Objects.AddBrep(brep, attr)
        baked_ids.append(obj_id)
        real_geometries.append(brep)
    else:
        print(f"⚠️ 构件 {gid} 无法转换为 Brep")

sc.doc.Views.Redraw()

# ========== 设置视图 ==========
view = sc.doc.Views.ActiveView
vp = view.ActiveViewport
vp.SetCameraLocation(camera_pt, True)
vp.SetCameraTarget(target_pt, True)
vp.Camera35mmLensLength = 18.0

# 强制设置视图窗口大小为 1280x720
sc.doc.Views.ActiveView.Size = System.Drawing.Size(img_width, img_height)

mode = Rhino.Display.DisplayModeDescription.FindByName("Rendered")  #Rendered
if mode:
    vp.DisplayMode = mode

view.Redraw()
time.sleep(0.5)

# ========== 导出图像为 24-bit 96dpi（用于 YOLO） ==========
bmp = view.CaptureToBitmap(System.Drawing.Size(img_width, img_height))
if bmp:
    # 设置分辨率
    bmp.SetResolution(96, 96)

    # 检查是否为 32 位图像（带 Alpha）
    if bmp.PixelFormat == System.Drawing.Imaging.PixelFormat.Format32bppArgb:
        # 创建新的 24 位图像（RGB）
        rgb_bmp = System.Drawing.Bitmap(bmp.Width, bmp.Height, System.Drawing.Imaging.PixelFormat.Format24bppRgb)
        rgb_bmp.SetResolution(96, 96)

        # 在新图上绘制旧图（自动丢弃 Alpha）
        g = System.Drawing.Graphics.FromImage(rgb_bmp)
        g.DrawImage(bmp, 0, 0)
        g.Dispose()

        # 保存 24-bit 图像
        rgb_bmp.Save(full_img_path, System.Drawing.Imaging.ImageFormat.Png)
        rgb_bmp.Dispose()
    else:
        # 如果原图已是 RGB，则直接保存
        bmp.Save(full_img_path, System.Drawing.Imaging.ImageFormat.Png)

    bmp.Dispose()
    print(f"📸 Saved as 24-bit RGB: {full_img_path}")


# ========== 导出标签 ==========
view_width = img_width
view_height = img_height

projected_components = []
csv_lines = []

for obj_id, gid, pt in zip(baked_ids, ids, center_points):
    obj = sc.doc.Objects.Find(obj_id)
    if not obj:
        continue
    try:
        bbox = obj.Geometry.GetBoundingBox(True)
        corners = bbox.GetCorners()
        screen_pts = [vp.WorldToClient(cpt) for cpt in corners]

        # 注意：使用真实图片尺寸进行像素投影
        xs = [pt.X * (img_width / view_width) for pt in screen_pts]
        ys = [pt.Y * (img_height / view_height) for pt in screen_pts]

        x_min = min(xs)
        x_max = max(xs)
        y_min = min(ys)
        y_max = max(ys)

        # 限制边界在图像范围内
        x_min = min(max(x_min, 0), img_width - 1)
        x_max = min(max(x_max, 0), img_width - 1)
        y_min = min(max(y_min, 0), img_height - 1)
        y_max = min(max(y_max, 0), img_height - 1)

        screen_center = vp.WorldToClient(pt)
        x_pixel = screen_center.X * (img_width / view_width)
        y_pixel = screen_center.Y * (img_height / view_height)

        x_norm = x_pixel / img_width
        y_norm = y_pixel / img_height

        projected_components.append({
            "id": gid,
            "world": [pt.X, pt.Y, pt.Z],
            "pixel": [x_pixel, y_pixel],
            "normalized": [round(x_norm, 6), round(y_norm, 6)],
            "bbox_2d": [x_min, y_min, x_max, y_max]
        })

        csv_lines.append(f"{gid},{pt.X:.3f},{pt.Y:.3f},{pt.Z:.3f}")

    except Exception as e:
        print(f"⚠️ 投影失败 {gid}: {e}")

# ========== 写入 JSON（追加） ==========
meta = {
    "filename": filename,
    "step": step_index,
    "camera_index": cam_index,
    "camera_origin": [camera_pt.X, camera_pt.Y, camera_pt.Z],
    "target_point": [target_pt.X, target_pt.Y, target_pt.Z],
    "display_mode": "Rendered_1",  #Rendered
    "total_steps": total_steps,
    "components": projected_components
}

if os.path.exists(json_path):
    with open(json_path, "r") as f:
        json_data = json.load(f)
else:
    json_data = []

json_data.append(meta)

with open(json_path, "w") as f:
    json.dump(json_data, f, indent=2)
    print(f"📄 JSON written: {json_path}")

# ========== 写入 CSV（首次写） ==========
if not os.path.exists(csv_path):
    with open(csv_path, "w") as f:
        for line in csv_lines:
            f.write(line + "\n")
    print(f"📅 CSV written: {csv_path}")

# ========== 恢复 GH 文档 ==========
sc.doc = ghdoc
a = "Done"
# ---------- end python_3_script ----------
panel_22 = Panel(python_3_script.out)
